vi "Initialize app subroutine.gvi"   [LabVIEW NXG 5.0.0]
inputs:
  "Error In": error
  "Initialize App Bundle Cluster In": "Initialize App Bundle Cluster.gtype"
  "Debugging Cluster": "Debugging Cluster.gtype"
outputs:
  "Error Out": error
  "Initialize App Bundle Cluster Out": "Initialize App Bundle Cluster.gtype"
types:
  "All Paths Cluster.gtype" = cluster{"Thorlabs Motor Serial Number File Path": path}
  "Instrument Coms Info.gtype" = cluster{"Arduino Coms Info": "Arduino Detection cluster control.gtype", "Photodetector Names": string[], "Keythley Address": "VISA Instr", "Photodetector Detected?": bool, "Thorlabs Motors Detected?": bool, "Keithley Detected?": bool, "Thorlabs Motors Serial Number": "Thorlabs Motors Serial Number In.gtype", "Photodetector IVI session": "Ivi IviDefault"}
  "Initialize App Bundle Cluster.gtype" = cluster{"All Paths": "All Paths Cluster.gtype", "Instrument Addresses": "Instrument Coms Info.gtype"}
  "Debugging Cluster.gtype" = cluster{"Debugging mode?": bool, "Initialize App": bool}
uses:
  Rainbow Measurement Setup::Main Functions::Instruction Queue::Current State::FGV Current State.gvi
  Rainbow Measurement Setup::Main Functions::Initialize App::Instruction Extractor Initialize.gvi
  Rainbow Measurement Setup::Side Functions::Instrument Control::Thorlabs Motors::Detection::Thorlabs Serial Number Check.gvi
  Rainbow Measurement Setup::Side Functions::Global Abort::FGV Global Abort.gvi
  Rainbow Measurement Setup::Side Functions::Instrument Control::Arduino::XZ Stage Arduino::XZ Stage Homed FGV.gvi
  Rainbow Measurement Setup::Side Functions::Instrument Control::Instruction Extractor Instruments to Detect.gvi
  Rainbow Measurement Setup::Side Functions::Instrument Control::Instrument Detector.gvi
diagram:
  Property Node(instance in=$"Debugging Cluster") -> ("Debugging mode?"=w1, "Initialize App"=w2)
  Logical And(w1, not w2) -> w3
  case (w3) {
    frame True {
      w4 = $"Error In"
    }
    frame False {
      case ($"Error In") {
        frame Error, Default {
          w4 = $"Error In"
        }
        frame No Error {
          call "FGV Current State.gvi"(Current State Instructions="Set Current State", Current State="Initialize App", Error In=$"Error In") -> (Error Out=w5)
          call "Instruction Extractor Initialize.gvi"(Initialize app subroutine states="Reset Disabled/Enabled Controls", Error In=w5) -> (Initialize app States array=w6, SubStates Output Array=w7, Error Out=w8)
          s1 = w8  # shift register
          s2 = $"Initialize App Bundle Cluster In"  # shift register
          for {
            w9 = each element of w6
            w10 = each element of w7
            call "FGV Current State.gvi"(Current State Instructions="Set Current Substate", Current Substate=w10, Error In=s1) -> (Error Out=w11)
            case (w9) {
              frame "Read Configuration Files" {
                call "Thorlabs Serial Number Check.gvi"(Initialize App Bundle Cluster In=s2, Error In=w11) -> (Initialize App Bundle Cluster Out=w13, Error Out=w12)
              }
              frame "Reset Disabled/Enabled Controls", Default {
                w12 = w11
                w13 = s2
              }
              frame "Reset Doubles" {
                w12 = w11
                w13 = s2
              }
              frame "Reset Booleans" {
                w12 = w11
                w13 = s2
              }
              frame "Reset Strings" {
                w12 = w11
                w13 = s2
              }
              frame "Reset Global Variables" {
                call "FGV Global Abort.gvi"(Global Abort Instructions="Reset State", Error In=w11) -> (Error Out=w14)
                call "XZ Stage Homed FGV.gvi"(FGV Instructions="Reset State", Error In=w14) -> (Error Out=w12)
                w13 = s2
              }
              frame "Detect Instruments" {
                call "Instruction Extractor Instruments to Detect.gvi"(Instruments To Detect control="Photodetector", Error In=w11) -> (Instruments To Detect Array=w15, Error Out=w16)
                s3 = w16  # shift register
                s4 = s2  # shift register
                for {
                  w17 = each element of w15
                  Property Node(instance in=s4) -> ("Instrument Addresses"=w18, instance out=w19)
                  call "Instrument Detector.gvi"(Instruments To Detect control=w17, Instrument Addresses In=w18, Error In=s3) -> (Instrument Addresses Out=w20, Error Out=w21)
                  Property Node(instance in=w19, "Instrument Addresses"=w20) -> (instance out=w22)
                  call "FGV Global Abort.gvi"(Global Abort Instructions="Read Current State", Error In=w21) -> (Global Abort Out=w23, Error Out=w24)
                  next s3 = w24
                  next s4 = w22
                  stop if w23
                }
                w12 = s3
                w13 = s4
              }
            }
            call "FGV Global Abort.gvi"(Global Abort Instructions="Read Current State", Error In=w12) -> (Global Abort Out=w25, Error Out=w26)
            next s1 = w26
            next s2 = w13
            stop if w25
          }
          $"Initialize App Bundle Cluster Out" <- s2
          w4 = s1
        }
      }
    }
  }
  $"Error Out" <- w4
