vi "MSpot Calibration Save Graphs Prompt.gvi"   [LabVIEW NXG 5.0.0]
inputs:
  "M Spot Spectrum Calibration State Machine Instructions": "MSpot Spectrum Calibration State Machine Instructions.gtype" = "Stop App"
  "Error In": error
outputs:
  "Selected State": "MSpot Spectrum Calibration State Machine Instructions.gtype"
  "Error Out": error
types:
  "MSpot Spectrum Calibration State Machine Instructions.gtype" = enum{"Start App", "Detect Instruments", "Initialize Instruments", "Rainbow Sweep", "Close Coms", "Load Calibration", "Check Graphs", "Save Graphs", "Stop App"}
diagram:
  # This subVI Prompts the user to save or discard the calibration files in case
  # we are coming from close coms wich means that a new calibration has been
  # performed. Otherwise it does not
  case ($"Error In") {
    frame Error, Default {
      w1 = "Stop App"
      w2 = $"Error In"
    }
    frame No Error {
      case ($"M Spot Spectrum Calibration State Machine Instructions") {
        frame "Load Calibration" {
          w1 = "Stop App"
        }
        frame "Close Coms" {
          w3 = "Do you wish to save the current\ncalibration files?\nThey will be saved on the Extra \ninstallers folder."
          Two Button Dialog(F button name ("Cancel")="Oh, don't bother\nI was just testing.", T button name ("OK")="Yes please save \nthe calibration files :D", message=w3) -> (T Button?=w4)
          Select(s=w4, t="Save Graphs", f="Stop App") -> w1
        }
        frame "Start App", Default {
          w1 = "Stop App"
        }
      }
      w2 = $"Error In"
    }
  }
  $"Selected State" <- w1
  $"Error Out" <- w2
