vi "MSpot Spectra file handling.gvi"   [LabVIEW NXG 5.0.0]
inputs:
  "Error In": error
  "Full MSpot Multispectral Data Array In": "Full MSpot Multispectral Data.gtype"[]
  "Modify File Operation": "Modify File Operation.gtype" = "Save TXT"
outputs:
  "Error Out": error
  "Full MSpot Multispectral Data Array Out": "Full MSpot Multispectral Data.gtype"[]
  "Found Any File?": bool
types:
  "MSpot Spectrum Data.gtype" = cluster{"M Spot Spectrum": cluster{"Wavelength": f64[], "Counts": f64[]}, "Blue Motor Position (mm)": f64, "Red Motor Position (mm)": f64}
  "Rainbow Sweep Types.gtype" = enum{"Red Sweep Closing", "Red Sweep Opening", "Blue Sweep Closing", "Blue Sweep Opening"}
  "Full MSpot Multispectral Data.gtype" = cluster{"MSpot Spectrum Data Array": "MSpot Spectrum Data.gtype"[], "Rainbow Sweep Types": "Rainbow Sweep Types.gtype"}
  "Modify File Operation.gtype" = enum{"Save TXT", "Load TXT"}
uses:
  Rainbow Measurement Setup::Main Functions::One Time Calibrations::MSpot Spectrum::File Handling::MSpot Folder Scan.gvi
  Rainbow Measurement Setup::Main Functions::One Time Calibrations::MSpot Spectrum::File Handling::Folder Scan Sweep type.gvi
  Rainbow Measurement Setup::Main Functions::One Time Calibrations::MSpot Spectrum::File Handling::File number Sorter.gvi
  Rainbow Measurement Setup::Main Functions::One Time Calibrations::MSpot Spectrum::File Handling::MSpot Data Extractor.gvi
  Rainbow Measurement Setup::Main Functions::One Time Calibrations::MSpot Spectrum::File Handling::MSpot Folder Check.gvi
  Rainbow Measurement Setup::Side Functions::Sample Naming::txt Extension adder.gvi
  Rainbow Measurement Setup::Main Functions::Modify TXT file::Modify Measurement TXT File.gvi
diagram:
  # This subVI Handles the Saving of all the MSpot Spectra Calibration Files
  case ($"Error In") {
    frame Error, Default {
      w1 = $"Error In"
      w2 = $"Full MSpot Multispectral Data Array In"
      w3 = default
    }
    frame No Error {
      case ($"Modify File Operation") {
        frame "Load TXT" {
          call "MSpot Folder Scan.gvi"(Error In=$"Error In") -> (Folder Path=w4, Folder Names=w5, Error Out=w6)
          s1 = w6  # shift register
          s2 = "Full MSpot Multispectral Data.gtype"[] []  # shift register
          s3 = 0  # shift register
          for {
            w7 = each element of w5
            call "Folder Scan Sweep type.gvi"(Folder Name In=w7, Error In=s1) -> (Foldername Out=w9, Sweep Type=w10, Is folder sweep type?=w11, Error Out=w12)
            case (w11) {
              frame False, Default {
                w13 = s3
                w14 = s2
                w15 = w12
                w16 = default
              }
              frame True {
                Array Index(array=s2) -> (out0[s3]=w17)
                Build Path(base path=w4, name or relative path=w9) -> (appended path=w18)
                List Folder(error in=w12, path=w18) -> (error out=w19, file names=w20, path out=w21)
                call "File number Sorter.gvi"(Sweep Type=w10, File Names=w20, Error In=w19) -> (Sorted Files Array=w22, Error Out=w23)
                s4 = w23  # shift register
                s5 = "MSpot Spectrum Data.gtype"[] []  # shift register
                s6 = 0  # shift register
                for {
                  w24 = each element of w22
                  Build Path(base path=w21, name or relative path=w24) -> (appended path=w26)
                  Search And Replace String(input string=w24, search string="MSpot_Spectrum_Calibration") -> (number of replacements=w27)
                  Is Not Equal To 0(x=w27) -> w28
                  call "MSpot Data Extractor.gvi"(Filepath to load=w26, Sub Array Index In=s6, M Spot Spectrum Sub Array In=s5, Modify file operation=$"Modify File Operation", Calibration file?=w28, Error In=s4) -> (Sub Array Index Out=w29, M Spot Spectrum Sub Array Out=w30, File Found?=w31, Error Out=w32)
                  append w31 to w25
                  next s4 = w32
                  next s5 = w30
                  next s6 = w29
                }
                Property Node(instance in=w17, "MSpot Spectrum Data Array"=s5, "Rainbow Sweep Types"=w10) -> (instance out=w33)
                Insert Into Array(inArray=s2, new=w33) -> w14
                Or Array Elements(Boolean array=w25) -> (logical OR=w16)
                Increment(x=s3) -> w13
                w15 = s4
              }
            }
            append w16 to w8
            next s1 = w15
            next s2 = w14
            next s3 = w13
          }
          Or Array Elements(Boolean array=w8) -> (logical OR=w3)
          w1 = s1
          w2 = s2
        }
        frame "Save TXT", Default {
          s7 = $"Error In"  # shift register
          for {
            w34 = each element of $"Full MSpot Multispectral Data Array In"
            Property Node(instance in=w34) -> ("MSpot Spectrum Data Array"=w35, "Rainbow Sweep Types"=w36)
            call "MSpot Folder Check.gvi"(Rainbow Sweep Types=w36, Error In=s7) -> (Folder Out=w37, Error Out=w38)
            s8 = w38  # shift register
            for {
              w39 = each element of w35
              Property Node(instance in=w39) -> ("M Spot Spectrum"=w40, "Blue Motor Position (mm)"=w41, "Red Motor Position (mm)"=w42)
              Format Into String(w41) -> w43
              Format Into String(w42) -> w44
              Concatenate Strings("Blue Motor Position (mm): ", w43, "\t", "Red Motor Position (mm): ", w44) -> w45
              Format Into String(initString="MSpot_Spectrum_Calibration_Position_", w41) -> w46
              Concatenate Strings(w46, "_") -> w47
              Format Into String(initString=w47, w42) -> w48
              call "txt Extension adder.gvi"(Name without .txt=w48, Error In=s8) -> (Name with .txt=w49, Error Out=w50)
              Property Node(instance in=w40) -> ("Wavelength"=w51, "Counts"=w52)
              Build Array(w51, w52) -> w53
              Transpose 2D Array(2D array=w53) -> (transposed array=w54)
              Build Path(base path=w37, name or relative path=w49) -> (appended path=w55)
              call "Modify Measurement TXT File.gvi"(Filename to load/save=w55, Variable Header Info=w45, Modify File Operation=$"Modify File Operation", Data To Save=w54, Error In=w50, Measurement File Type="Light Calibration Dividing Wavelength Spectrum") -> (Error Out=w56)
              next s8 = w56
            }
            next s7 = s8
          }
          w1 = s7
          w2 = $"Full MSpot Multispectral Data Array In"
          w3 = default
        }
      }
    }
  }
  $"Full MSpot Multispectral Data Array Out" <- w2
  $"Error Out" <- w1
  $"Found Any File?" <- w3
