vi "MSpot Spectrum Rainbow Sweep Subroutine.gvi"   [LabVIEW NXG 5.0.0]
inputs:
  "Instrument Coms Info In": "Instrument Coms Info.gtype"
  "MSpot Spectrum Calibration Parameters": "MSpot Spectrum Calibration Parameters.gtype" = {"Min Position (mm)"=0, "Max Position (mm)"=10, "Position step size (mm)"=0.1}
  "Manual Input": bool
  "Rainbow Sweep Param Selector": "Rainbow Sweep Param Selector.gtype" = {0, 1100, 300, 1, 1, 0}
  "Error In": error
  "Debugging Cluster In": "Debugging Cluster.gtype"
outputs:
  "Instrument Coms Info Out": "Instrument Coms Info.gtype"
  "Full MSpot Multispectral Data Array": "Full MSpot Multispectral Data.gtype"[]
  "Debugging Cluster Out": "Debugging Cluster.gtype"
  "Error Out": error
types:
  "Raibow Sweep Selector.gtype" = enum{"Red Sweep", "Blue Sweep", "Full Sweep Red First", "Full Sweep Blue First"}
  "Rainbow Sweep Type Selector.gtype" = cluster{"Red Sweep Mode": enum{"Red Sweep Closing", "Red Sweep Opening"}, "Blue Sweep Mode": enum{"Blue Sweep Opening", "Blue Sweep Closing"}}
  "Rainbow Sweep Param Selector.gtype" = cluster{"Raibow Sweep Selector": "Raibow Sweep Selector.gtype", "Max Wavelength (nm)": f64, "Min Wavelength (nm)": f64, "Wavelength Step (nm)": f64, "Rainbow Sweep Types": "Rainbow Sweep Type Selector.gtype"}
  "MSpot Spectrum Data.gtype" = cluster{"M Spot Spectrum": cluster{"Wavelength": f64[], "Counts": f64[]}, "Blue Motor Position (mm)": f64, "Red Motor Position (mm)": f64}
  "Rainbow Sweep Types.gtype" = enum{"Red Sweep Closing", "Red Sweep Opening", "Blue Sweep Closing", "Blue Sweep Opening"}
  "Full MSpot Multispectral Data.gtype" = cluster{"MSpot Spectrum Data Array": "MSpot Spectrum Data.gtype"[], "Rainbow Sweep Types": "Rainbow Sweep Types.gtype"}
  T1 = cluster{"Element 1": "VISA Instr", "Element 2": string}
  "Arduino Detection cluster control.gtype" = cluster{"XZ Stage Arduino Address": "VISA Instr", "XZ Stage Arduino Detected?": bool, "Multiplexer Arduino Detected?": bool, "Multiplexer Arduino Address": "VISA Instr", "Arduinos List": T1[], "XZ Stage Log": string, "Multiplexer Log": string}
  "Thorlabs Motors Serial Number In.gtype" = cluster{"Thorlabs Blue Motor": string, "Thorlabs Red Motor": string, "Blue Motor Homed?": bool, "Red Motor Homed?": bool}
  "Instrument Coms Info.gtype" = cluster{"Arduino Coms Info": "Arduino Detection cluster control.gtype", "Photodetector Names": string[], "Keythley Address": "VISA Instr", "Photodetector Detected?": bool, "Thorlabs Motors Detected?": bool, "Keithley Detected?": bool, "Thorlabs Motors Serial Number": "Thorlabs Motors Serial Number In.gtype", "Photodetector IVI session": "Ivi IviDefault"}
  "MSpot Spectrum Calibration Parameters.gtype" = cluster{"Min Position (mm)": f64, "Max Position (mm)": f64, "Position step size (mm)": f64}
  "Insturment Debugging Cluster.gtype" = cluster{"Keithley": bool, "Arduinos": bool, "Thorlabs Motors": bool, "Photodetector": bool}
  "Debugging Cluster.gtype" = cluster{"Debugging mode?": bool, "Initialize App": bool, "Insturment Debugging": "Insturment Debugging Cluster.gtype"}
uses:
  Rainbow Measurement Setup::Main Functions::One Time Calibrations::MSpot Spectrum::MSpot Step Calculator.gvi
  Rainbow Measurement Setup::Side Functions::Rainbow Sweep::Rainbow Sweep Type Extractor.gvi
  Rainbow Measurement Setup::Side Functions::Instrument Control::Thorlabs Motors::Movement::KCube Initialize and Home.gvi
  Rainbow Measurement Setup::Main Functions::One Time Calibrations::MSpot Spectrum::Random Data Generator.gvi
  Rainbow Measurement Setup::Side Functions::Instrument Control::Thorlabs Motors::Movement::KCube Motor Single Move to Position.gvi
  Rainbow Measurement Setup::Side Functions::Instrument Control::Thorlabs Motors::Movement::KCube Motors Close.gvi
diagram:
  # This SubVI Performs a scan of the spectrum of the beam (STILL FLAME CONNECTION MISSING) and then moves the blade motors to perform a full scan of the spectrum with respect to position.
  case ($"Error In") {
    frame Error, Default {
      w1 = default
      w2 = $"Error In"
      w3 = $"Instrument Coms Info In"
      w4 = $"Debugging Cluster In"
    }
    frame No Error {
      call "MSpot Step Calculator.gvi"(MSpot Spectrum Calibration Parameters In=$"MSpot Spectrum Calibration Parameters") -> (Number of steps=w5)
      call "Rainbow Sweep Type Extractor.gvi"(Rainbow Sweep Parameters=$"Rainbow Sweep Param Selector", Error In=$"Error In") -> (Rainbow Sweep Array=w6, Error Out=w7)
      s1 = "Full MSpot Multispectral Data.gtype"[] []  # shift register
      s2 = w7  # shift register
      s3 = $"Instrument Coms Info In"  # shift register
      s4 = $"Debugging Cluster In"  # shift register
      for (iteration -> i1) {
        w8 = each element of w6
        Array Index(array=s1) -> (out0[i1]=w9)
        case (w8) {
          frame "Red Sweep Opening", Default {
            call "KCube Initialize and Home.gvi"(Instrument Coms Info In=s3, Debugging Cluster In=s4, Error In=s2, KCube Motor Selector="Blue Motor") -> (Instrument Coms Info Out=w14, Debugging Cluster Out=w15, Error Out=w16)
            s5 = w16  # shift register
            s6 = "MSpot Spectrum Data.gtype"[] []  # shift register
            s7 = w14  # shift register
            s8 = w15  # shift register
            for (N = w5) (iteration -> i2) {
              case ($"Manual Input") {
                frame False, Default { }
                frame True {
                  Wait Until Next Multiple(multiple to wait=300)
                  w17 = "Please Save the spectrum file\non the oceanview software\nbefore continuing."
                  One Button Dialog(button name ("OK")="Okay, I will", message=w17)
                }
              }
              Property Node(instance in=$"MSpot Spectrum Calibration Parameters") -> ("Max Position (mm)"=w18, "Position step size (mm)"=w19)
              To Double Precision Float(number=i2) -> w20
              Multiply(w19, w20) -> w21
              Subtract(x=w18, y=w21) -> w22
              call "Random Data Generator.gvi"() -> (Beam Spectrum=w23)
              Property Node(instance in="MSpot Spectrum Data.gtype" {all zero or empty}, "M Spot Spectrum"=w23, "Blue Motor Position (mm)"=w22, "Red Motor Position (mm)"=0) -> (instance out=w24)
              Insert Into Array(inArray=s6, index0=i2, new=w24) -> w25
              call "KCube Motor Single Move to Position.gvi"(Instrument Coms Info In=s7, Debugging Cluster In=s8, Motor Position to move to (mm)=w22, Error In=s5, KCube Motor Selector="Blue Motor") -> (Instrument Coms Info Out=w26, Debugging Cluster Out=w27, Error Out=w28)
              next s5 = w28
              next s6 = w25
              next s7 = w26
              next s8 = w27
            }
            Property Node(instance in=w9, "Rainbow Sweep Types"=w8, "MSpot Spectrum Data Array"=s6) -> (instance out=w12)
            call "KCube Motors Close.gvi"(Instrument Coms Info In=s7, Error In=s5) -> (Instrument Coms Info Out=w10, Error Out=w11)
            w13 = s8
          }
          frame "Red Sweep Closing" {
            call "KCube Initialize and Home.gvi"(Instrument Coms Info In=s3, Debugging Cluster In=s4, Error In=s2, KCube Motor Selector="Blue Motor") -> (Instrument Coms Info Out=w29, Debugging Cluster Out=w30, Error Out=w31)
            s9 = w31  # shift register
            s10 = "MSpot Spectrum Data.gtype"[] []  # shift register
            s11 = w29  # shift register
            s12 = w30  # shift register
            for (N = w5) (iteration -> i3) {
              case ($"Manual Input") {
                frame False, Default { }
                frame True {
                  Wait Until Next Multiple(multiple to wait=300)
                  w32 = "Please Save the spectrum file\non the oceanview software\nbefore continuing."
                  One Button Dialog(button name ("OK")="Okay, I will", message=w32)
                }
              }
              Property Node(instance in=$"MSpot Spectrum Calibration Parameters") -> ("Min Position (mm)"=w33, "Position step size (mm)"=w34)
              To Double Precision Float(number=i3) -> w35
              Multiply(w34, w35) -> w36
              Add(w33, w36) -> w37
              call "Random Data Generator.gvi"() -> (Beam Spectrum=w38)
              Property Node(instance in="MSpot Spectrum Data.gtype" {all zero or empty}, "M Spot Spectrum"=w38, "Blue Motor Position (mm)"=w37, "Red Motor Position (mm)"=0) -> (instance out=w39)
              Insert Into Array(inArray=s10, index0=i3, new=w39) -> w40
              call "KCube Motor Single Move to Position.gvi"(Instrument Coms Info In=s11, Debugging Cluster In=s12, Motor Position to move to (mm)=w37, Error In=s9, KCube Motor Selector="Blue Motor") -> (Instrument Coms Info Out=w41, Debugging Cluster Out=w42, Error Out=w43)
              next s9 = w43
              next s10 = w40
              next s11 = w41
              next s12 = w42
            }
            Property Node(instance in=w9, "Rainbow Sweep Types"=w8, "MSpot Spectrum Data Array"=s10) -> (instance out=w12)
            call "KCube Motors Close.gvi"(Instrument Coms Info In=s11, Error In=s9) -> (Instrument Coms Info Out=w10, Error Out=w11)
            w13 = s12
          }
          frame "Blue Sweep Closing" {
            call "KCube Initialize and Home.gvi"(Instrument Coms Info In=s3, Debugging Cluster In=s4, Error In=s2, KCube Motor Selector="Red Motor") -> (Instrument Coms Info Out=w44, Debugging Cluster Out=w45, Error Out=w46)
            s13 = w46  # shift register
            s14 = "MSpot Spectrum Data.gtype"[] []  # shift register
            s15 = w45  # shift register
            s16 = w44  # shift register
            for (N = w5) (iteration -> i4) {
              case ($"Manual Input") {
                frame False, Default { }
                frame True {
                  Wait Until Next Multiple(multiple to wait=300)
                  w47 = "Please Save the spectrum file\non the oceanview software\nbefore continuing."
                  One Button Dialog(button name ("OK")="Okay, I will", message=w47)
                }
              }
              Property Node(instance in=$"MSpot Spectrum Calibration Parameters") -> ("Min Position (mm)"=w48, "Position step size (mm)"=w49)
              To Double Precision Float(number=i4) -> w50
              Multiply(w49, w50) -> w51
              Add(w48, w51) -> w52
              call "Random Data Generator.gvi"() -> (Beam Spectrum=w53)
              Property Node(instance in="MSpot Spectrum Data.gtype" {all zero or empty}, "M Spot Spectrum"=w53, "Red Motor Position (mm)"=w52, "Blue Motor Position (mm)"=0) -> (instance out=w54)
              Insert Into Array(inArray=s14, index0=i4, new=w54) -> w55
              call "KCube Motor Single Move to Position.gvi"(Instrument Coms Info In=s16, Debugging Cluster In=s15, Motor Position to move to (mm)=w52, Error In=s13, KCube Motor Selector="Red Motor") -> (Instrument Coms Info Out=w56, Debugging Cluster Out=w57, Error Out=w58)
              next s13 = w58
              next s14 = w55
              next s15 = w57
              next s16 = w56
            }
            Property Node(instance in=w9, "Rainbow Sweep Types"=w8, "MSpot Spectrum Data Array"=s14) -> (instance out=w12)
            call "KCube Motors Close.gvi"(Instrument Coms Info In=s16, Error In=s13) -> (Instrument Coms Info Out=w10, Error Out=w11)
            w13 = s15
          }
          frame "Blue Sweep Opening" {
            call "KCube Initialize and Home.gvi"(Instrument Coms Info In=s3, Debugging Cluster In=s4, Error In=s2, KCube Motor Selector="Red Motor") -> (Instrument Coms Info Out=w59, Debugging Cluster Out=w60, Error Out=w61)
            s17 = w61  # shift register
            s18 = "MSpot Spectrum Data.gtype"[] []  # shift register
            s19 = w60  # shift register
            s20 = w59  # shift register
            for (N = w5) (iteration -> i5) {
              case ($"Manual Input") {
                frame False, Default { }
                frame True {
                  Wait Until Next Multiple(multiple to wait=300)
                  w62 = "Please Save the spectrum file\non the oceanview software\nbefore continuing."
                  One Button Dialog(button name ("OK")="Okay, I will", message=w62)
                }
              }
              Property Node(instance in=$"MSpot Spectrum Calibration Parameters") -> ("Position step size (mm)"=w63, "Max Position (mm)"=w64)
              To Double Precision Float(number=i5) -> w65
              Multiply(w63, w65) -> w66
              Subtract(x=w64, y=w66) -> w67
              call "Random Data Generator.gvi"() -> (Beam Spectrum=w68)
              Property Node(instance in="MSpot Spectrum Data.gtype" {all zero or empty}, "M Spot Spectrum"=w68, "Red Motor Position (mm)"=w67, "Blue Motor Position (mm)"=0) -> (instance out=w69)
              Insert Into Array(inArray=s18, index0=i5, new=w69) -> w70
              call "KCube Motor Single Move to Position.gvi"(Instrument Coms Info In=s20, Debugging Cluster In=s19, Motor Position to move to (mm)=w67, Error In=s17, KCube Motor Selector="Red Motor") -> (Instrument Coms Info Out=w71, Debugging Cluster Out=w72, Error Out=w73)
              next s17 = w73
              next s18 = w70
              next s19 = w72
              next s20 = w71
            }
            Property Node(instance in=w9, "Rainbow Sweep Types"=w8, "MSpot Spectrum Data Array"=s18) -> (instance out=w12)
            call "KCube Motors Close.gvi"(Instrument Coms Info In=s20, Error In=s17) -> (Instrument Coms Info Out=w10, Error Out=w11)
            w13 = s19
          }
        }
        Insert Into Array(inArray=s1, index0=i1, new=w12) -> w74
        next s1 = w74
        next s2 = w11
        next s3 = w10
        next s4 = w13
      }
      w1 = s1
      w2 = s2
      w3 = s3
      w4 = s4
    }
  }
  $"Instrument Coms Info Out" <- w3
  $"Debugging Cluster Out" <- w4
  $"Full MSpot Multispectral Data Array" <- w1
  $"Error Out" <- w2
