vi "MSpot Spectrum Visualizer.gvi"   [LabVIEW NXG 5.0.0]
inputs:
  "Error In": error
  "Full MSpot Multispectral Data Array": "Full MSpot Multispectral Data.gtype"[]
outputs:
  "Error Out": error
panel controls:
  "Sweep Type Selector": i32
  "Graph (position) Selector": i32
  "Continue": bool
  "cutoff frequency": f64 = 0.125
  "Threshold": f64
panel indicators:
  "Rainbow Sweep Type": "Rainbow Sweep Types.gtype"
  "M Spot Spectrum": cluster{"Element 1": f64[], "Element 2": f64[]}[]
  "MSpot Spectrum Data": "MSpot Spectrum Data.gtype"
types:
  "Rainbow Sweep Types.gtype" = enum{"Red Sweep Closing", "Red Sweep Opening", "Blue Sweep Closing", "Blue Sweep Opening"}
  "MSpot Spectrum Data.gtype" = cluster{"M Spot Spectrum": cluster{"Wavelength": f64[], "Counts": f64[]}, "Blue Motor Position (mm)": f64, "Red Motor Position (mm)": f64, "Dividing Wavelength (nm)": f64}
  "Full MSpot Multispectral Data.gtype" = cluster{"MSpot Spectrum Data Array": "MSpot Spectrum Data.gtype"[], "Rainbow Sweep Types": "Rainbow Sweep Types.gtype"}
uses:
  Rainbow Measurement Setup::Main Functions::One Time Calibrations::MSpot Spectrum::Dividing Wavelength Calculations::Dividing Wavelength Calculator.gvi
  Rainbow Measurement Setup::Main Functions::One Time Calibrations::MSpot Spectrum::Dividing Wavelength Calculations::Spectrum Blank Correction.gvi
  NI::Analysis::IntegralDifferentiation::Derivative x(t).gvi
  NI::Analysis::Filtering::Butterworth Lowpass Filter (DBL).gvi
diagram:
  Property Node(instance in=reference to unnamed native front panel, error in=$"Error In") -> ("Window"=w1, error out=w2)
  Open Window(reference in=w1, error in=w2) -> (reference out=w3, error out=w4)
  # This subVI allows us to visualize the data obtained on the Measuring Spot Spectrum Calibration subroutine so that we can
  # extract our own conclusions and elaborate the calibration file.
  case (w4) {
    frame Error, Default {
      w5 = w4
    }
    frame No Error {
      while {
        call "Dividing Wavelength Calculator.gvi"(Full MSpot Multispectral Data Array In=$"Full MSpot Multispectral Data Array", Error In=w4, Dividing Wavelength Threshold=$Threshold, cutoff frequency=$"cutoff frequency") -> (Full MSpot Multispectral Data Array Out=w6, Error Out=w7)
        Array Index(array=w6) -> (out0[$"Sweep Type Selector"]=w8)
        Array Size(array=w6) -> (size(s)=w9)
        Decrement(x=w9) -> w10
        Is Equal To 0(x=w10) -> w11
        Not(x=w11) -> w12
        Property Node(instance in=reference to "Sweep Type Selector", "Maximum"=w10, "Minimum"=0, "Visible"=w12, error in=w7) -> (error out=w13)
        call "Spectrum Blank Correction.gvi"(Full MSpot Multispectral Data=w8, Error In=w13) -> (Corrected Data=w14, Error Out=w15)
        Property Node(instance in=w14) -> ("MSpot Spectrum Data Array"=w16, "Rainbow Sweep Types"=w17)
        Array Index(array=w16) -> (out0[$"Graph (position) Selector"]=w18)
        Property Node(instance in=w18) -> ("M Spot Spectrum"=w19, "Dividing Wavelength (nm)"=w20)
        Property Node(instance in=w19) -> ("Wavelength"=w21, "Counts"=w22)
        Build Cluster(w21, w22) -> w23
        call "Derivative x(t).gvi"(x(t)=w22) -> (dx(t)/dt=w24)
        Absolute Value(x=w24) -> w25
        Build Cluster(w21, w25) -> w26
        call "Butterworth Lowpass Filter (DBL).gvi"(signal=w25, cutoff frequency=$"cutoff frequency") -> (filtered signal=w27)
        Build Cluster(w21, w27) -> w28
        Build Array(w26, w28, w23) -> w29
        $"M Spot Spectrum" <- w29
        $"MSpot Spectrum Data" <- w18
        Array Size(array=w16) -> (size(s)=w30)
        Decrement(x=w30) -> w31
        Property Node(instance in=reference to "Graph (position) Selector", "Minimum"=0, "Maximum"=w31, error in=w15) -> (error out=w5)
        Wait Until Next Multiple(multiple to wait=50)
        $"Rainbow Sweep Type" <- w17
        Property Node(instance in=reference to "M Spot Spectrum") -> ("Cursor"=w32)
        Property Node(instance in=w32, "XPosition"=w20, "Visible"=TRUE)
        stop if $Continue
      }
    }
  }
  Close Window(reference in=w3, error in=w5) -> (error out=w33)
  $"Error Out" <- w33
