vi "SRM Check Light Power Data.gvi"   [LabVIEW NXG 5.0.0]
inputs:
  "Error In": error
  "Light Power Calibration Data In": "Light Power Calibration Data.gtype"[]
  "Rainbow Sweep Param Selector In": "Rainbow Sweep Param Selector.gtype" = {0, 1100, 300, 1, 1, 0}
  "Input State": "SRM States.gtype" = "Detect Instruments"
outputs:
  "Error Out": error
  "Next State": "SRM States.gtype"
  "Rainbow Sweep Param Selector Out": "Rainbow Sweep Param Selector.gtype"
types:
  T1 = cluster{"Dividing Wavelength Array": f64[], "Measured Power Array": f64[]}
  "Rainbow Sweep Types.gtype" = enum{"Red Sweep Closing", "Red Sweep Opening", "Blue Sweep Closing", "Blue Sweep Opening"}
  "Light Power Calibration Data.gtype" = cluster{"Single Light Calibration": T1, "Rainbow Sweep Types": "Rainbow Sweep Types.gtype"}
  "Raibow Sweep Selector.gtype" = enum{"Red Sweep", "Blue Sweep", "Full Sweep Red First", "Full Sweep Blue First"}
  T2 = enum{"Red Sweep Closing", "Red Sweep Opening", "Red Sweep Both Ways"}
  T3 = enum{"Blue Sweep Opening", "Blue Sweep Closing", "Blue Sweep Both Ways"}
  "Rainbow Sweep Type Selector.gtype" = cluster{"Red Sweep Mode": T2, "Blue Sweep Mode": T3}
  "Rainbow Sweep Param Selector.gtype" = cluster{"Raibow Sweep Selector": "Raibow Sweep Selector.gtype", "Max Wavelength (nm)": f64, "Min Wavelength (nm)": f64, "Wavelength Step (nm)": f64, "Rainbow Sweep Type Selector": "Rainbow Sweep Type Selector.gtype"}
  "SRM States.gtype" = enum{"Start App", "Load Light Power Calibration", "Detect Instruments", "Initialize Instruments", "Rainbow Sweep", "Close Coms", "Process IV Data", "Load Measurement", "Save Graphs", "Enqueue Light Calibration", "Stop App"}
uses:
  Rainbow Measurement Setup::Side Functions::Rainbow Sweep::Rainbow Sweep Param Generator.gvi
  Rainbow Measurement Setup::Main Functions::Rainbow Measurement::Cell Single Rainbow Measurement::LPC Check::SRM Wrong Calibration Files Prompt.gvi
  Rainbow Measurement Setup::Main Functions::Rainbow Measurement::Cell Single Rainbow Measurement::LPC Check::SRM Sweep Type check prompt.gvi
  Rainbow Measurement Setup::Main Functions::Rainbow Measurement::Cell Single Rainbow Measurement::LPC Check::SRM Light Power Check Operation Translator.gvi
  Rainbow Measurement Setup::Main Functions::Rainbow Measurement::Light Power Calibration::Light Power Operation FGV.gvi
diagram:
  # This SubVI Checks that the loaded light power calibration data is compatible with the selected rainbow sweep type and
  # if not it prompts the user with some options on what to do next. It also checks that the loaded light power calibration
  # is compatible with the selected rainbow sweep parameters such as wavelength step and range.
  case ($"Error In") {
    frame Error, Default {
      w1 = $"Error In"
      w2 = $"Rainbow Sweep Param Selector In"
      w3 = "Stop App"
    }
    frame No Error {
      Is Empty Array(array=$"Light Power Calibration Data In") -> w4
      case (w4) {
        frame False, Default {
          call "Rainbow Sweep Param Generator.gvi"(Rainbow Sweep Parameters=$"Rainbow Sweep Param Selector In", Error In=$"Error In") -> (Rainbow Sweep Parameters Array=w8, Error Out=w9)
          s1 = w9  # shift register
          s2 = $"Rainbow Sweep Param Selector In"  # shift register
          for {
            w10 = each element of w8
            Property Node(instance in=w10) -> ("Rainbow Sweep Types"=w14)
            for {
              w15 = each element of $"Light Power Calibration Data In"
              Property Node(instance in=w15) -> ("Rainbow Sweep Types"=w17)
              Is Equal(x=w17, y=w14) -> w18
              append w18 to w16
            }
            Or Array Elements(Boolean array=w16) -> (logical OR=w19)
            Not(x=w19) -> w20
            s3 = s1  # shift register
            s4 = s2  # shift register
            for {
              w21 = each element of $"Light Power Calibration Data In"
              call "SRM Wrong Calibration Files Prompt.gvi"(Rainbow Sweep Param Selector In=s4, Light Power Calibration Data In=w21, Error In=s3) -> (Rainbow Sweep Parameters Selector Out=w23, Cancelled Measurement?=w24, Error Out=w25)
              append w24 to w22
              next s3 = w25
              next s4 = w23
            }
            Or Array Elements(Boolean array=w22) -> (logical OR=w26)
            append w14 to w11 if w20
            append w20 to w12
            append w26 to w13
            next s1 = s3
            next s2 = s4
          }
          Or Array Elements(Boolean array=w12) -> (logical OR=w27)
          call "SRM Sweep Type check prompt.gvi"(Missing Calibration Files=w11, Missing Calibration Files?=w27, Error In=s1) -> (User selected option=w6, Error Out=w5)
          Or Array Elements(Boolean array=w13) -> (logical OR=w7)
          w2 = s2
        }
        frame True {
          w28 = "I could not find any light power calibration data. Make sure that you have either performed a light power calibration or that you have loaded the needed files. "
          Three Button Dialog(Allow user to close window? (TRUE)=FALSE, Center Button Text ("No")="Load Light Power\nCalibration files.", Left Button Text ("Yes")="New Light Power\nCalibration Now", Right Button Text ("Cancel")="Cancel\nMeasurement", Window Title (" ")="Missing Light power Calibration files", message=w28) -> (Which Button?=w6)
          w5 = $"Error In"
          w2 = $"Rainbow Sweep Param Selector In"
          w7 = default
        }
      }
      call "SRM Light Power Check Operation Translator.gvi"(User Selected Operation=w6, Error In=w5, Input State=$"Input State") -> (Next State=w29, Light Power Operation Control=w30, Error Out=w31)
      call "Light Power Operation FGV.gvi"(FGV Instructions="Set State", Light Power Operation In=w30, Error In=w31) -> (Error Out=w1)
      Select(s=w7, t="Stop App", f=w29) -> w3
    }
  }
  $"Error Out" <- w1
  $"Next State" <- w3
  $"Rainbow Sweep Param Selector Out" <- w2
