vi "Light Power Calibration Subroutine.gvi"   [LabVIEW NXG 5.0.0]
inputs:
  "Error In": error
  "Instrument Coms Info In": "Instrument Coms Info.gtype"
  "Debugging Cluster In": "Debugging Cluster.gtype"
  "Default Data Saving Location": path
  "Stand Alone?": bool
  "Light Power Calibration Data In": "Light Power Calibration Data.gtype"[]
  "Cell Naming Cluster": "Cell Naming Cluster.gtype"
  "Rainbow Sweep Param Selector": "Rainbow Sweep Param Selector.gtype" = {0, 1100, 300, 1, 1, 0}
  "Light Power Operation Control": "Light Power Operation Control.gtype" = "Save Calibration"
outputs:
  "Error Out": error
  "Instuments Coms Info Out": "Instrument Coms Info.gtype"
  "Debugging Cluster Out": "Debugging Cluster.gtype"
  "Light Power Calibration Data Out": "Light Power Calibration Data.gtype"[]
types:
  "Raibow Sweep Selector.gtype" = enum{"Red Sweep", "Blue Sweep", "Full Sweep Red First", "Full Sweep Blue First"}
  "Rainbow Sweep Type Selector.gtype" = cluster{"Red Sweep Mode": enum{"Red Sweep Closing", "Red Sweep Opening"}, "Blue Sweep Mode": enum{"Blue Sweep Opening", "Blue Sweep Closing"}}
  "Rainbow Sweep Param Selector.gtype" = cluster{"Raibow Sweep Selector": "Raibow Sweep Selector.gtype", "Max Wavelength (nm)": f64, "Min Wavelength (nm)": f64, "Wavelength Step (nm)": f64, "Rainbow Sweep Types": "Rainbow Sweep Type Selector.gtype"}
  "Insturment Debugging Cluster.gtype" = cluster{"Keithley": bool, "Arduinos": bool, "Thorlabs Motors": bool, "Photodetector": bool}
  "Debugging Cluster.gtype" = cluster{"Debugging mode?": bool, "Initialize App": bool, "Insturment Debugging": "Insturment Debugging Cluster.gtype"}
  T1 = cluster{"Element 1": "VISA Instr", "Element 2": string}
  "Arduino Detection cluster control.gtype" = cluster{"XZ Stage Arduino Address": "VISA Instr", "XZ Stage Arduino Detected?": bool, "Multiplexer Arduino Detected?": bool, "Multiplexer Arduino Address": "VISA Instr", "Arduinos List": T1[], "XZ Stage Log": string, "Multiplexer Log": string}
  "Thorlabs Motors Serial Number In.gtype" = cluster{"Thorlabs Blue Motor": string, "Thorlabs Red Motor": string, "Blue Motor Homed?": bool, "Red Motor Homed?": bool}
  "Instrument Coms Info.gtype" = cluster{"Arduino Coms Info": "Arduino Detection cluster control.gtype", "Photodetector Names": string[], "Keythley Address": "VISA Instr", "Photodetector Detected?": bool, "Thorlabs Motors Detected?": bool, "Keithley Detected?": bool, "Thorlabs Motors Serial Number": "Thorlabs Motors Serial Number In.gtype", "Photodetector IVI session": "Ivi IviDefault"}
  "Cell Naming Cluster.gtype" = cluster{"Cell Label": string, "Sample Prefix": string, "Author Initials": string, "Current Date": string, "Batch Name": string}
  T2 = cluster{"Dividing Wavelength Array": f64[], "Measured Power Array": f64[]}
  "Rainbow Sweep Types.gtype" = enum{"Red Sweep Closing", "Red Sweep Opening", "Blue Sweep Closing", "Blue Sweep Opening"}
  "Light Power Calibration Data.gtype" = cluster{"Single Light Calibration": T2, "Rainbow Sweep Types": "Rainbow Sweep Types.gtype"}
  "Light Power Operation Control.gtype" = enum{"Save Calibration", "Load Calibration", "New Calibration"}
uses:
  Rainbow Measurement Setup::Main Functions::Instruction Queue::Current State::FGV Current State.gvi
  Rainbow Measurement Setup::Side Functions::Instrument Control::Thorlabs Motors::Dividing Wavelength Control::Dividing Wavelength Calibration Data FGV.gvi
  Rainbow Measurement Setup::Side Functions::Instrument Control::Debug Cluster Instrument Extractor.gvi
  Rainbow Measurement Setup::Main Functions::One Time Calibrations::Beam Power Density::Specific Detect Instruments Subroutine.gvi
  Rainbow Measurement Setup::Side Functions::Instrument Control::Thorlabs Motors::Movement::KCube Move to 0 or Home.gvi
  Rainbow Measurement Setup::Side Functions::Instrument Control::Arduino::XZ Stage Arduino::XZ Stage Initialize And Home.gvi
  Rainbow Measurement Setup::Side Functions::Instrument Control::Photodetector::Photodetector Initialize.gvi
  Rainbow Measurement Setup::Main Functions::Rainbow Measurement::Light Power Calibration::Light Power Calibration Sweep.gvi
  Rainbow Measurement Setup::Side Functions::Instrument Control::Photodetector::Photodetector Close Coms.gvi
  Rainbow Measurement Setup::Side Functions::Instrument Control::Arduino::XZ Stage Arduino::XZ Stage Close Coms.gvi
  Rainbow Measurement Setup::Side Functions::Instrument Control::Thorlabs Motors::Movement::KCube Motors Close.gvi
  Rainbow Measurement Setup::Main Functions::Rainbow Measurement::Light Power Calibration::File Handling::Light power Calibration Save Graphs Prompt.gvi
  Rainbow Measurement Setup::Main Functions::Rainbow Measurement::Light Power Calibration::File Handling::Light Calibration file handling.gvi
  Rainbow Measurement Setup::Main Functions::Rainbow Measurement::Light Power Calibration::File Handling::Light Power Calibration Load Prompt.gvi
  Rainbow Measurement Setup::Side Functions::Global Abort::FGV Global Abort.gvi
diagram:
  # This SubVI Measures the Light power for each motor position for each sweep type and outputs the data so that it can be plotted
  # on the main window for checking and for calibration purposes
  case ($"Error In") {
    frame Error, Default {
      w1 = $"Error In"
      w2 = default
      w3 = $"Instrument Coms Info In"
      w4 = $"Debugging Cluster In"
    }
    frame No Error {
      call "FGV Current State.gvi"(Current State Instructions="Set Current State and Substate", Current State="Light Power Calibration", Current Substate="", Error In=$"Error In") -> (Error Out=w5)
      s1 = w5  # shift register
      s2 = "Start App"  # shift register
      s3 = $"Debugging Cluster In"  # shift register
      s4 = $"Instrument Coms Info In"  # shift register
      s5 = $"Light Power Calibration Data In"  # shift register
      while {
        case (s2) {
          frame "Start App", Default {
            Select(s=$"Stand Alone?", t="Detect Instruments", f="Initialize Instruments") -> w12
            Is Equal(x="Save Calibration", y=$"Light Power Operation Control") -> w13
            Select(s=w13, t="Save Graphs", f=w12) -> w14
            Is Equal(x="Load Calibration", y=$"Light Power Operation Control") -> w15
            Select(s=w15, t="Load Calibration", f=w14) -> w7
            call "FGV Current State.gvi"(Current State Instructions="Set Current Substate", Current Substate="Starting Light Power Calibration", Error In=s1) -> (Error Out=w6)
            w8 = s3
            w9 = s4
            w10 = s5
            w11 = default
          }
          frame "Detect Instruments" {
            call "FGV Current State.gvi"(Current State Instructions="Set Current Substate", Current Substate="Detecting Instruments", Error In=s1) -> (Error Out=w16)
            call "Dividing Wavelength Calibration Data FGV.gvi"(General FGV Instructions="Set State", Error In=w16) -> (Error Out=w17)
            call "Debug Cluster Instrument Extractor.gvi"(Debugging Cluster In=s3, Error In=w17) -> (Debuging Cluster Out=w8, Instruments to Detect=w18, Error Out=w19)
            call "Specific Detect Instruments Subroutine.gvi"(Instrument Coms Info In=s4, Error In=w19, Instruments To Detect Array=w18) -> (Instrument Coms Info Out=w9, Error Out=w6)
            w7 = "Initialize Instruments"
            w10 = s5
            w11 = default
          }
          frame "Initialize Instruments" {
            call "FGV Current State.gvi"(Current State Instructions="Set Current Substate", Current Substate="Initializing Instruments", Error In=s1) -> (Error Out=w20)
            call "KCube Move to 0 or Home.gvi"(Instrument Coms Info In=s4, Debugging Cluster In=s3, Error In=w20) -> (Instrument Coms Info Out=w21, Debugging Cluster Out=w22, Error Out=w23)
            call "XZ Stage Initialize And Home.gvi"(Instrument Coms Info In=w21, Debugging Cluster In=w22, Error In=w23) -> (Instrument Coms Info Out=w24, Debugging Cluster Out=w25, Error Out=w26)
            call "Photodetector Initialize.gvi"(Instrument Coms Info In=w24, Debugging Cluster In=w25, Error In=w26) -> (Instrument Coms Info Out=w9, Debugging Cluster Out=w8, Error Out=w6)
            w7 = "Rainbow Sweep"
            w10 = s5
            w11 = default
          }
          frame "Rainbow Sweep" {
            call "FGV Current State.gvi"(Current State Instructions="Set Current Substate", Current Substate="Acquiring Spectra", Error In=s1) -> (Error Out=w27)
            call "Light Power Calibration Sweep.gvi"(Instrument Coms Info In=s4, Debugging Cluster In=s3, Rainbow Sweep Param Selector=$"Rainbow Sweep Param Selector", Error In=w27) -> (Instrument Coms Info Out=w9, Debugging Cluster Out=w8, Light Power Calibration Data=w10, Error Out=w6)
            w7 = "Close Coms"
            w11 = default
          }
          frame "Close Coms" {
            call "FGV Current State.gvi"(Current State Instructions="Set Current Substate", Current Substate="Closing Coms", Error In=s1) -> (Error Out=w28)
            call "Photodetector Close Coms.gvi"(Instrument Coms Info In=s4, Debugging Cluster In=s3, Error In=w28) -> (Instrument Coms Info Out=w29, Debugging Cluster Out=w8, Error Out=w30)
            call "XZ Stage Close Coms.gvi"(Instrument Coms Info In=w29, Error In=w30) -> (Instrument Coms Info Out=w31, Error Out=w32)
            call "KCube Motors Close.gvi"(Instrument Coms Info In=w31, Error In=w32) -> (Instrument Coms Info Out=w9, Error Out=w33)
            call "Light power Calibration Save Graphs Prompt.gvi"(Error In=w33) -> (Desired State=w7, Error Out=w6)
            w10 = s5
            w11 = default
          }
          frame "Load Calibration" {
            call "FGV Current State.gvi"(Current State Instructions="Set Current Substate", Current Substate="Loading Calibration", Error In=s1) -> (Error Out=w34)
            call "Light Calibration file handling.gvi"(Modify File Operation="Load TXT", Error In=w34) -> (Light Power Calibration Data Out=w10, Found Any File?=w35, Error Out=w36)
            call "Light Power Calibration Load Prompt.gvi"(Found Any File?=w35, Stand Alone=$"Stand Alone?", Error In=w36) -> (Desired State=w7, Error Out=w6)
            w8 = s3
            w9 = s4
            w11 = default
          }
          frame "Save Graphs" {
            call "FGV Current State.gvi"(Current State Instructions="Set Current Substate", Current Substate="Saving Graphs", Error In=s1) -> (Error Out=w37)
            call "Light Calibration file handling.gvi"(Default Data Saving Location=$"Default Data Saving Location", Light Power Calibration Data In=s5, Modify File Operation="Save TXT", Error In=w37, Cell Naming Cluster=$"Cell Naming Cluster") -> (Light Power Calibration Data Out=w10, Error Out=w6)
            w7 = "Stop App"
            w8 = s3
            w9 = s4
            w11 = default
          }
          frame "Stop App" {
            call "FGV Current State.gvi"(Current State Instructions="Set Current Substate", Current Substate="Stopping Apps", Error In=s1) -> (Error Out=w6)
            w7 = "Start App"
            w8 = s3
            w9 = s4
            w10 = s5
            w11 = TRUE
          }
        }
        call "FGV Global Abort.gvi"(Global Abort Instructions="Read Current State", Error In=w6) -> (Local Abort Out=w38, Global Abort Out=w39, Error Out=w40)
        Logical Or(w38, w39, w40, w11) -> w41
        next s1 = w40
        next s2 = w7
        next s3 = w8
        next s4 = w9
        next s5 = w10
        stop if w41
      }
      w1 = s1
      w2 = s5
      w3 = s4
      w4 = s3
    }
  }
  $"Light Power Calibration Data Out" <- w2
  $"Error Out" <- w1
  $"Instuments Coms Info Out" <- w3
  $"Debugging Cluster Out" <- w4
