vi "Instrument Detector.gvi"   [LabVIEW NXG 5.0.0]
inputs:
  "Error In": error
  "Instruments To Detect control": "Instruments To Detect control.gtype" = "Photodetector", required
  "Initialize App Bundle Cluster": "Initialize App Bundle Cluster.gtype"
outputs:
  "Error Out": error
  "Initialize App Bundle Cluster Out": "Initialize App Bundle Cluster.gtype"
types:
  "Instruments To Detect control.gtype" = enum{"Photodetector", "Keithley", "Arduinos", "Thorlabs Motors"}
  "All Paths Cluster.gtype" = cluster{"Thorlabs Motor Serial Number File Path": path}
  "Instrument Address Output Cluster.gtype" = cluster{"Arduino Coms Info": "Arduino Detection cluster control.gtype", "Photodetector Names": string[], "Keythley Address": "VISA Instr", "Photodetector Detected?": bool, "Thorlabs Motors Detected?": bool, "Keithley Detected?": bool, "Thorlabs Motors Serial Number": "Thorlabs Motors Serial Number In.gtype"}
  "Initialize App Bundle Cluster.gtype" = cluster{"All Paths": "All Paths Cluster.gtype", "Instrument Addresses": "Instrument Address Output Cluster.gtype"}
uses:
  Rainbow Measurement Setup::Main Functions::Instruction Queue::Current State::FGV Current State.gvi
  Rainbow Measurement Setup::Side Functions::Instrument Control::Photodetector Detection Subroutine.gvi
  Rainbow Measurement Setup::Side Functions::Instrument Control::Keithley Detection Subroutine.gvi
  Rainbow Measurement Setup::Side Functions::Instrument Control::Arduino::Arduino Detection Subroutine.gvi
  Rainbow Measurement Setup::Side Functions::Instrument Control::Thorlabs Motors::Thorlabs motor Detector.gvi
diagram:
  case ($"Error In") {
    frame Error, Default {
      w1 = $"Error In"
    }
    frame No Error {
      Property Node(instance in=$"Initialize App Bundle Cluster") -> ("Instrument Addresses"=w2)
      case ($"Instruments To Detect control") {
        frame "Photodetector", Default {
          call "FGV Current State.gvi"(Current State Instructions="Set current Substate", Current Substate="Detecting Photodetector", Error In=$"Error In") -> (Error Out=w4)
          call "Photodetector Detection Subroutine.gvi"(Error In=w4) -> (Photodetector Names=w5, Detected?=w6, Error Out=w1)
          Property Node(instance in=w2, "Photodetector Names"=w5, "Photodetector Detected?"=w6) -> (instance out=w3)
        }
        frame "Keithley" {
          call "FGV Current State.gvi"(Current State Instructions="Set current Substate", Current Substate="Detecting Keithley", Error In=$"Error In") -> (Error Out=w7)
          call "Keithley Detection Subroutine.gvi"(Error In=w7) -> (Keythley Address Out=w8, Detected?=w9, Error Out=w1)
          Property Node(instance in=w2, "Keythley Address"=w8, "Keithley Detected?"=w9) -> (instance out=w3)
        }
        frame "Arduinos" {
          call "FGV Current State.gvi"(Current State Instructions="Set current Substate", Current Substate="Detecting Arduinos", Error In=$"Error In") -> (Error Out=w10)
          call "Arduino Detection Subroutine.gvi"(Error In=w10) -> (Arduino Detection Cluster Info Out=w11, Error Out=w1)
          Property Node(instance in=w2, "Arduino Coms Info"=w11) -> (instance out=w3)
        }
        frame "Thorlabs Motors" {
          Property Node(instance in=w2) -> ("Thorlabs Motors Serial Number"=w12, instance out=w13)
          call "FGV Current State.gvi"(Current State Instructions="Set current Substate", Current Substate="Detecting Thorlabs Motors", Error In=$"Error In") -> (Error Out=w14)
          call "Thorlabs motor Detector.gvi"(Thorlabs Motors Serial Number In=w12, Error In=w14) -> (Detected?=w15, Thorlabs Motors Serial Number Out=w16, Error Out=w1)
          Property Node(instance in=w13, "Thorlabs Motors Detected?"=w15, "Thorlabs Motors Serial Number"=w16) -> (instance out=w3)
        }
      }
      Property Node(instance in=$"Initialize App Bundle Cluster", "Instrument Addresses"=w3) -> (instance out=w17)
      $"Initialize App Bundle Cluster Out" <- w17
    }
  }
  $"Error Out" <- w1
