vi "Keithley Sweep Subroutine.gvi"   [LabVIEW NXG 5.0.0]
inputs:
  "Error In": error
  "Debugging Cluster In": "Debugging Cluster.gtype"
  "Instrument Coms Info In": "Instrument Coms Info.gtype"
  "SRM Specific Parameters In": "SRM Specific Parameters.gtype"
outputs:
  "Error Out": error
  "Instrument Coms Info Out": "Instrument Coms Info.gtype"
  "Debugging Cluster Out": "Debugging Cluster.gtype"
  "IV Sweep Data": cluster{"Voltage": f64[], "Current": f64[]}
types:
  T1 = cluster{"Element 1": "VISA Instr", "Element 2": string}
  "Arduino Detection cluster control.gtype" = cluster{"XZ Stage Arduino Address": "VISA Instr", "XZ Stage Arduino Detected?": bool, "Multiplexer Arduino Detected?": bool, "Multiplexer Arduino Address": "VISA Instr", "Arduinos List": T1[], "XZ Stage Log": string, "Multiplexer Log": string}
  "Thorlabs Motors Serial Number In.gtype" = cluster{"Thorlabs Blue Motor": string, "Thorlabs Red Motor": string, "Blue Motor Homed?": bool, "Red Motor Homed?": bool}
  "Instrument Coms Info.gtype" = cluster{"Arduino Coms Info": "Arduino Detection cluster control.gtype", "Photodetector Names": string[], "Keythley Address": "VISA Instr", "Photodetector Detected?": bool, "Thorlabs Motors Detected?": bool, "Keithley Detected?": bool, "Thorlabs Motors Serial Number": "Thorlabs Motors Serial Number In.gtype", "Photodetector IVI session": "Ivi IviDefault", "Flame ID": string, "Flame Detected?": bool, "Flame Wrapper ID": u64}
  "Insturment Debugging Cluster.gtype" = cluster{"Keithley": bool, "Arduinos": bool, "Thorlabs Motors": bool, "Photodetector": bool, "Flame Spectr": bool}
  "Debugging Cluster.gtype" = cluster{"Debugging mode?": bool, "Initialize App": bool, "Insturment Debugging": "Insturment Debugging Cluster.gtype"}
  "SRM Specific Parameters.gtype" = cluster{"Max Voltage (V)": f64, "Min Voltage (V)": f64, "Voltage Points": u32, "Current Range (A)": f64, "Autorange": bool, "Sweep Direction": bool, "Current Averages": u32, "Max Current (A)": f64, "Integration Time": f64}
uses:
  Rainbow Measurement Setup::Side Functions::Instrument Control::Keithley::Random IV Curve Generator.gvi
  Rainbow Measurement Setup::Main Functions::Instruction Queue::Current State::FGV Current State.gvi
  Labview_NXG_Keithley_SMU_2450_2460_2461::Configure::Clear Buffer.gvi
  Labview_NXG_Keithley_SMU_2450_2460_2461::Action Status::Enable Output.gvi
  Labview_NXG_Keithley_SMU_2450_2460_2461::Data::Low Level::Initiate.gvi
  Labview_NXG_Keithley_SMU_2450_2460_2461::Data::Low Level::Wait for Operation Complete.gvi
  Labview_NXG_Keithley_SMU_2450_2460_2461::Data::Read (Multiple Points).gvi
diagram:
  # This SubVI Initializes the Keithley Comunication In case the debugging allows it to do so
  case ($"Error In") {
    frame Error, Default {
      w1 = $"Error In"
      w2 = $"Instrument Coms Info In"
      w3 = $"Debugging Cluster In"
      w4 = default
    }
    frame No Error {
      Property Node(instance in=$"Debugging Cluster In") -> ("Debugging mode?"=w5, "Insturment Debugging:Keithley"=w6, instance out=w3)
      Logical And[output inverted](w5, not w6) -> w7
      case (w7) {
        frame False, Default {
          call "Random IV Curve Generator.gvi"(Array Lenght=100, Error In=$"Error In") -> (Voltage=w8, Current=w9, Error Out=w1)
          w10 = cluster{"Voltage": f64[], "Current": f64[]} {all zero or empty}
          Property Node(instance in=w10, "Voltage"=w8, "Current"=w9) -> (instance out=w4)
          w2 = $"Instrument Coms Info In"
        }
        frame True {
          Property Node(instance in=$"SRM Specific Parameters In") -> ("Voltage Points"=w11)
          Property Node(instance in=$"Instrument Coms Info In") -> ("Keythley Address"=w12, instance out=w13)
          call "FGV Current State.gvi"(Current State Instructions="Set Current Substate", Current Substate="Sweeping Keithley", Error In=$"Error In") -> (Error Out=w14)
          call "Clear Buffer.gvi"(VISA resource name=w12, error in (no error)=w14) -> (VISA resource name out=w15, error out=w16)
          call "Enable Output.gvi"(VISA resource name=w15, Enable Output (T: Enable)=TRUE, error in (no error)=w16) -> (VISA resource name out=w17, error out=w18)
          call "Initiate.gvi"(VISA resource name=w17, error in (no error)=w18) -> (VISA resource name out=w19, error out=w20)
          call "Wait for Operation Complete.gvi"(VISA resource name=w19, Timeout (10000 ms)=100000, error in (no error)=w20) -> (VISA resource name out=w21, error out=w22)
          call "Read (Multiple Points).gvi"(VISA resource name=w21, Start Index (1)=1, End Index (1)=w11, error in (no error)=w22, Buffer Elements="SOUR, READ") -> (VISA resource name out=w23, Data out=w24, error out=w25)
          Spreadsheet String To Array(array type=f64[][] [], delimiter=",", format string="%s", spreadsheet string=w24) -> (array=w26)
          Array Index(array=w26) -> (out0[_, 0]=w27, out1[_, 1]=w28)
          w29 = cluster{"Voltage": f64[], "Current": f64[]} {all zero or empty}
          Property Node(instance in=w29, "Voltage"=w27, "Current"=w28) -> (instance out=w4)
          call "Enable Output.gvi"(VISA resource name=w23, Enable Output (T: Enable)=FALSE, error in (no error)=w25) -> (VISA resource name out=w30, error out=w1)
          Property Node(instance in=w13, "Keythley Address"=w30) -> (instance out=w2)
        }
      }
    }
  }
  $"Debugging Cluster Out" <- w3
  $"IV Sweep Data" <- w4
  $"Instrument Coms Info Out" <- w2
  $"Error Out" <- w1
